# Grasshopper definition membrane.gh (Grasshopper 1.0.7)
# plug-ins: Kangaroo2 Components

crv = Curve(<curve referenced from the Rhino model>)
patch = Patch(Curves=crv, Spans=20, Flexibility=1, Trim=True)
loft = Loft(Curves=crv, Options={Adjust=False, Closed=False, LoftEnds=0, LoftSimp=0, LoftType=0, Rebuild=10, Refit=0.01})
mesh = MeshBrep(
    Brep=patch,
    Settings={GridMaxCount=0, GridMinCount=16, JaggedSeams=False, MaxEdgeLength=0, MinEdgeLength=0.0001, MinTolerance=0, Refine=True, RefineAngle=0, RelativeTolerance=0.65, SimplePlanes=True, Tolerance=0})
triremesh = TriRemesh(Geometry=mesh, Length="0.8", Iterations=25)  # -> Triangulation, Dual, Creases
edgelengths = EdgeLengths(Mesh=triremesh.Triangulation, LengthFactor=Slider(0, range=0..1), Strength=Slider(0.314, range=0..1))
nv = NakedVertices(Mesh=triremesh.Triangulation)  # -> ClothedIndex, NakedIndex, ClothedPts, NakedPts
vertexloads = VertexLoads(Mesh=triremesh.Triangulation, Strength=Slider(0.065, range=0..0.1))
anchor = Anchor(Point=nv.NakedPts, Target=nv.NakedPts, Strength="10")
show = Show(G=triremesh.Triangulation)
entwine = Entwine(Branch00=show, Branch01=edgelengths, Branch02=anchor, Branch03=vertexloads, FlattenInputs=True)
solver = Solver(GoalObjects=entwine, Reset=False, Threshold=1e-15, Tolerance=0.0001, On=Toggle(True))  # -> I, V, O
bang = ExplodeTree(Data=solver.O)  # -> Branch0, Branch1, Branch2, Branch3
mesh_2 = Mesh(bang.Branch0)
medges = MeshEdges(Mesh=mesh_2)  # -> NakedEdges, InteriorEdges, NonManifoldEdges
