# Grasshopper definition ovo.gh (Grasshopper 1.0.7)
# plug-ins: Weaverbird, Kangaroo2 Components

mesh = Mesh(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)
medges = MeshEdges(Mesh=mesh)  # -> NakedEdges, InteriorEdges, NonManifoldEdges
wbsplitquads = WeaverbirdsConstantQuadsSplitSubdivision(MeshCurves=mesh, Level="3", SmoothNakedEdges=1)
medges_2 = MeshEdges(Mesh=wbsplitquads)  # -> NakedEdges, InteriorEdges, NonManifoldEdges
pipe = Pipe(Curve=medges.NakedEdges, Radius="0.05", Caps=0)
pipe_2 = Pipe(Curve=medges.InteriorEdges, Radius="0.03", Caps=0)
join = JoinCurves(Curves=medges.NakedEdges, Preserve=False)
demesh = DeconstructMesh(Mesh=mesh)  # -> Vertices, Faces, Colours, Normals
wbnaked = WeaverbirdsNakedBoundary(MeshClosedPolylines=wbsplitquads)
cpoly = ControlPolygon(Curve=join)  # -> Polygon, Points
intcrv = Interpolate(Vertices=cpoly.Points, Degree=3, Periodic=False, KnotStyle=1)  # -> Curve, Length, Domain
number_slider = Slider(100, range=0..100)  # disabled
number_slider_2 = Slider(-0.001, range=-1..1)  # disabled
cpoly_2 = ControlPolygon(Curve=wbnaked)  # -> Polygon, Points; disabled
edgelengths = EdgeLengths(Mesh=wbsplitquads, LengthFactor=1, Strength=Slider(1.5, range=0..2))  # disabled
vertexloads = VertexLoads(Mesh=wbsplitquads, Strength=number_slider_2)  # disabled
anchor = Anchor(Point=demesh.Vertices, Target=demesh.Vertices, Strength=number_slider)  # disabled
duppt = RemoveDuplicatePts(Points=flatten(cpoly_2.Points), Tolerance=0.01)  # disabled
show = Show(G=wbsplitquads)  # disabled
number_slider_3 = Slider(100, range=0..100)  # disabled
toggle = BooleanToggle(True)  # disabled
toggle_2 = BooleanToggle(False)  # disabled
anchor_2 = Anchor(Point=duppt, Target=duppt, Strength=number_slider_3)  # disabled
entwine = Entwine(Branch00=show, Branch01=edgelengths, Branch02=vertexloads, Branch03=anchor, Branch04=anchor_2, FlattenInputs=True)  # disabled
solver = Solver(GoalObjects=entwine, Reset=toggle_2, Threshold=1e-15, Tolerance=0.0001, On=toggle)  # -> I, V, O; disabled
bang = ExplodeTree(Data=solver.O)  # -> Branch0, Branch1, Branch2, Branch3; disabled
mesh_2 = Mesh(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)  # disabled
